# Grasshopper definition Solihiya.gh (Grasshopper 1.0.7)
# plug-ins: Kangaroo2 Components, Weaverbird

# ---- group: RH_In: zHeight
number_slider = Slider(0.05, range=0..0.05)

# ---- group: RH_In: solAngle
number_slider_2 = Slider(43, range=0..180)

# ---- group: RH_In: toD
number_slider_3 = Slider(5, range=1..9)

# ---- group: RH_In: smlOpening
number_slider_4 = Slider(40, range=0..40)

# ---- group: RH_In: lrgOpening
number_slider_5 = Slider(0, range=0..10)

# ----
crv = Curve(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)
lrgopening = GetNumber(number_slider_5, AtLeast=1, AtMost=1, Maximum=40, Minimum=-1.797693135e+308)
tod = GetNumber(number_slider_3, AtLeast=1, AtMost=1, Maximum=9, Minimum=-1.797693135e+308)
smlopening = GetNumber(number_slider_4, AtLeast=1, AtMost=1, Maximum=40, Minimum=-1.797693135e+308)
zheight = GetNumber(number_slider, AtLeast=1, AtMost=1, Maximum=0.05, Minimum=-1.797693135e+308)
solangle = GetNumber(number_slider_2, AtLeast=1, AtMost=1, Maximum=180, Minimum=-1.797693135e+308)
boundary = BoundarySurfaces(Edges=crv)
explode = Explode(Curve=crv, Recursive=True)  # -> Segments, Vertices

bbox = BoundingBox(Content=crv, Plane=PlaneXY(0, 0, 0))  # -> Box, Box_2
debrep = DeconstructBrep(Brep=bbox.Box)  # -> Faces, Edges, Vertices
area = Area(Geometry=debrep.Faces)  # -> Area, Centroid
xy = XYPlane(Origin=Point(0, 0, 0))
sqrt = SquareRoot(Value=area.Area)
circle = CircleCNR(Center=area.Centroid, Normal=xy, Radius=sqrt)
sph = Sphere(Base=area.Centroid, Radius=sqrt)
divide = DivideCurve(Curve=circle, Count="2", Kinks=False)  # -> Points, Tangents, Parameters
item = ListItem(List=divide.Points, Index=0, Wrap=True)  # -> Item, Item1
geodesic = Geodesic(Surface=sph, Start=item.Item, End=item.Item1)
ln = Line(StartPoint=item.Item, EndPoint=item.Item1)
rad = Radians(Degrees=solangle)
neg = Negative(Value=rad)
rot3d = Rotate3D(Geometry=geodesic, Angle=neg, Center=area.Centroid, Axis=ln)  # -> Geometry, Transform
divide_2 = DivideCurve(Curve=rot3d.Geometry, Count=10, Kinks=False)  # -> Points, Tangents, Parameters
item_2 = ListItem(List=divide_2.Points, Index=tod, Wrap=True)

qrsettings = QuadRemeshSettings(TargetCount=1000, AdaptiveSize=0, AdaptiveCount=invert(False), HardEdges=False, SeamEdges=0, Symmetry=0, GuideCurves=0)
mesh = MeshBrep(
    Brep=boundary,
    Settings={GridMaxCount=0, GridMinCount=16, JaggedSeams=False, MaxEdgeLength=0, MinEdgeLength=0.0001, MinTolerance=0, Refine=True, RefineAngle=0, RelativeTolerance=0.65, SimplePlanes=True, Tolerance=0})
qrmesh = QuadRemesh(Mesh=mesh, Settings=qrsettings)

nv = NakedVertices(Mesh=qrmesh)  # -> ClothedIndex, NakedIndex, ClothedPts, NakedPts
cull = CullPattern(List=explode.Segments, CullPattern=[False, True])
pull = PullPoint(Point=nv.NakedPts, Geometry=cull, ClosestOnly=True)  # -> ClosestPoint, Distance
smaller = SmallerThan(FirstNumber=pull.Distance, SecondNumber=Slider(1e-05, range=0..1e-05))  # -> SmallerThan, OrEqualTo
cull_2 = CullPattern(List=pull.ClosestPoint, CullPattern=smaller.OrEqualTo)
pt = Point(cull_2)
edgelengths = EdgeLengths(Mesh=qrmesh, LengthFactor="1", Strength=1)
anchor = Anchor(Point=pt, Strength=10000)
vertexloads = VertexLoads(Mesh=qrmesh, Strength=zheight)
show = Show(G=qrmesh)
merge = Merge(Data1=show, Data2=anchor, Data3=vertexloads, Data4=edgelengths)
zombiesolver = ZombieSolver(GoalObjects=merge, Threshold=1e-10, Tolerance=0.0001, MaxIterations=50000)  # -> I, V, O

sphere = Sphere(Base=item_2, Radius=Slider(2, range=0..10))
bang = ExplodeTree(Data=zombiesolver.O)
item_3 = ListItem(List=bang, Index=0, Wrap=True)
pt_2 = Point(item_2)
facen = FaceNormals(Mesh=item_3)  # -> Centers, Normals
dist = Distance(PointA=facen.Centers, PointB=pt_2)
remap = Remap(data=dist, min=smlopening, max=lrgopening)
wbframe = WeaverbirdsPictureFrame(MeshPolylines=item_3, Distance=remap, InsetType=0)
bnd = Bounds(Numbers=dist)
wbcatmullclark = WeaverbirdsCatmullClarkSubdivision(MeshCurves=wbframe, Level=1, SmoothNakedEdges=1)
mesh_edges = MeshEdges(Mesh=wbcatmullclark)  # -> NakedEdges, InteriorEdges, NonManifoldEdges
boundary_2 = BoundarySurfaces(Edges=circle)
rh_out_sol_angle = Curve(rot3d.Geometry)
rh_out_plane = Brep(boundary_2)
rh_out_edges = Curve([mesh_edges.NakedEdges, mesh_edges.InteriorEdges])
rh_out_mesh = Mesh(wbcatmullclark)
rh_out_sun = Brep(sphere)

# ==== cluster Remap: Remaps numbers
data = ClusterInput()
min = ClusterInput()
max = ClusterInput()
bnd = Bounds(Numbers=data)
dom = ConstructDomain(DomainStart=min, DomainEnd=max)
remap = RemapNumbers(Value=data, Source=bnd, Target=dom)  # -> Mapped, Clipped
R = ClusterOutput(remap.Mapped)
